# Dynamo custom node Annotation BoundingBox.dyf (Dynamo 1.3.4.6666)
# category: GeniusLoci.Geometry
# Get the BoundingBox of the view specific element. (Text, tag, etc)

element = Input()
python_script = Python(IN[0]=element)
# ---------- python_script.python (15 lines) ----------
import clr
clr.AddReference('RevitNodes')
import Revit
clr.ImportExtensions(Revit.GeometryConversion)

annotations=UnwrapElement(IN[0]) if isinstance(IN[0],list) else [UnwrapElement(IN[0])]
bbox = []

for anno in annotations:
    viewId = anno.OwnerViewId
    view = anno.Document.GetElement(viewId)
    bbox.append(anno.BoundingBox[view].ToProtoType())

if isinstance(IN[0], list): OUT = bbox
else: OUT = bbox[0]
# ----------------------------------------
BoundingBox = Output(python_script)
