# Dynamo custom node Element GetRotation.dyf (Dynamo 1.3.4.6666)
# category: GeniusLoci.Geometry
# Calculates the rotation angle between the given element and the X axis.

element = Input()  # element or Dynamo line
python_script = Python(IN[0]=element)
# ---------- python_script.python (45 lines) ----------
#Alban de Chasteigner 2020
#twitter : @geniusloci_bim
#geniusloci.bim@gmail.com
#https://github.com/albandechasteigner/GeniusLociForDynamo

import clr
import math
clr.AddReference('RevitAPI')
import Autodesk
from Autodesk.Revit.DB import *
clr.AddReference('RevitNodes')
import Revit
clr.ImportExtensions(Revit.GeometryConversion)

items = UnwrapElement(IN[0]) if isinstance(IN[0],list) else [UnwrapElement(IN[0])]

def GetRotation(item):
	# Dynamo lines
	if hasattr(item, "Explode"):
		vector = item.ToRevitType().Direction
		rotationAngle = math.degrees(vector.AngleTo(XYZ.BasisX))
	# span direction angle of the floor 	
	elif isinstance(item, Autodesk.Revit.DB.Floor):
		rotationAngle = math.degrees(item.SpanDirectionAngle)
	elif hasattr(item, "Location"):
		loc = item.Location
		if loc:	
			# point-based elements (e.g. most loadable families)
			if isinstance(loc,LocationPoint):
				if hasattr(loc, "Rotation"):
					rotationAngle = math.degrees(loc.Rotation)
					if rotationAngle>180:
						rotationAngle=abs(rotationAngle-360)
					else:rotationAngle
			# line-based elements (e.g. walls)
			elif isinstance(loc,LocationCurve):
				vector = loc.Curve.Direction
				rotationAngle = math.degrees(vector.AngleTo(XYZ.BasisX))
			else: 
				rotationAngle = None
	return round(rotationAngle,3)
	
locations = [GetRotation(x) for x in items]

OUT = locations
# ----------------------------------------
Degree = Output(python_script)  # Angle
