# Dynamo custom node FamilyInstance Reference ByRefLine.dyf (Dynamo 1.3.4.6666)
# category: GeniusLoci.Reference
# Works only in Revit 2018.1 and later.
# Gets family instance references corresponding to the reference lines in the instance's family.

familyInstance = Input()
ReferenceType = Input(ReferenceType=null)  # Default = StrongReference
python_script = Python(IN[0]=familyInstance, IN[1]=ReferenceType)
# ---------- python_script.python (16 lines) ----------
import clr

elements = UnwrapElement(IN[0]) if isinstance(IN[0],list) else [UnwrapElement(IN[0])]
reftype = UnwrapElement(IN[1])
ref=[]

#Get Reference Lines from Families
for element in elements:
	if reftype == None:
		reference = element.GetReferences(FamilyInstanceReferenceType.StrongReference)
	else :
		reference = element.GetReferences(reftype)
	ref.append(reference)

if isinstance(IN[0], list): OUT = ref
else: OUT = ref[0]
# ----------------------------------------
Reference = Output(python_script)
